# Dynamo graph Auto numbering Cable Trays.dyn (Dynamo 2.6.1.8786)

select_model_elements = DSModelElementsSelection()  # 18 picked in the model
string = StringInput("Mark")
string_2 = StringInput("<")
code_block = CodeBlock { 1; }
count = List.Count(list=select_model_elements)
code_block_2 = CodeBlock { 1; }
range = Range(start=code_block, end=count, step=code_block_2)
string_from_object = FromObject(obj=range)
add = string_2 + string_from_object
string_3 = StringInput(">")
add_2 = add + string_3
string_from_object_2 = FromObject(obj=add_2)
setParameterByName = Element.SetParameterByName(element=select_model_elements, parameterName=string, value=string_from_object_2)
