# Dynamo graph AutoNumbering CT for all levels.dyn (Dynamo 2.6.1.8786)

select_model_elements = DSModelElementsSelection()  # 31 picked in the model
string = StringInput("Comments")
getParameterValueByName = Element.GetParameterValueByName(element=select_model_elements, parameterName=string)
string_2 = StringInput("LL")
eq = getParameterValueByName == string_2
filterByBoolMask = List.FilterByBoolMask(list=select_model_elements, mask=eq)
string_3 = StringInput("Mark")
string_4 = StringInput("<")
code_block = CodeBlock { 0; }
count = List.Count(list=filterByBoolMask.in)
code_block_2 = CodeBlock { 1; }
range = Range(start=code_block, end=count, step=code_block_2)
string_from_object = FromObject(obj=range)
add = string_4 + string_from_object
string_5 = StringInput(">")
add_2 = add + string_5
string_from_object_2 = FromObject(obj=add_2)
setParameterByName = Element.SetParameterByName(element=filterByBoolMask.in, parameterName=string_3, value=string_from_object_2)
string_6 = StringInput("HL")
eq_2 = getParameterValueByName == string_6
filterByBoolMask_2 = List.FilterByBoolMask(list=select_model_elements, mask=eq_2)
string_7 = StringInput("Mark")
string_8 = StringInput("<")
code_block_3 = CodeBlock { 1; }
add_3 = count + code_block_3
count_2 = List.Count(list=filterByBoolMask_2.in)
add_4 = add_3 + count_2
range_2 = Range(start=count, end=add_4, step=code_block_2)
string_from_object_3 = FromObject(obj=range_2)
add_5 = string_8 + string_from_object_3
string_9 = StringInput(">")
add_6 = add_5 + string_9
string_from_object_4 = FromObject(obj=add_6)
setParameterByName_2 = Element.SetParameterByName(element=filterByBoolMask_2.in, parameterName=string_7, value=string_from_object_4)
