# Dynamo graph CableTrayNumbering_CDP_WithoutPlaceholder.dyn (Dynamo 2.6.1.8786)

select_model_elements = DSModelElementsSelection()  # 24 picked in the model
string = StringInput("Comments")
getParameterValueByName = Element.GetParameterValueByName(element=select_model_elements, parameterName=string)
string_2 = StringInput("HL1")
eq = getParameterValueByName == string_2
filterByBoolMask = List.FilterByBoolMask(list=select_model_elements, mask=eq)
string_3 = StringInput("Mark")
string_4 = StringInput("<")
code_block = CodeBlock { 1; }
count = List.Count(list=filterByBoolMask.in)
range = Range(start=code_block, end=count, step=code_block)
string_from_object = FromObject(obj=range)
add = string_4 + string_from_object
string_5 = StringInput(">")
add_2 = add + string_5
string_from_object_2 = FromObject(obj=add_2)
setParameterByName = Element.SetParameterByName(element=filterByBoolMask.in, parameterName=string_3, value=string_from_object_2)
string_6 = StringInput("LL")
eq_2 = getParameterValueByName == string_6
filterByBoolMask_2 = List.FilterByBoolMask(list=select_model_elements, mask=eq_2)
lastItem = List.LastItem(list=range)
add_3 = lastItem + code_block
count_2 = List.Count(list=filterByBoolMask_2.in)
add_4 = count + count_2
range_2 = Range(start=add_3, end=add_4, step=code_block)
string_from_object_3 = FromObject(obj=range_2)
add_5 = string_4 + string_from_object_3
add_6 = add_5 + string_5
string_from_object_4 = FromObject(obj=add_6)
setParameterByName_2 = Element.SetParameterByName(element=filterByBoolMask_2.in, parameterName=string_3, value=string_from_object_4)
string_7 = StringInput("HL")
eq_3 = getParameterValueByName == string_7
filterByBoolMask_3 = List.FilterByBoolMask(list=select_model_elements, mask=eq_3)
lastItem_2 = List.LastItem(list=range_2)
add_7 = lastItem_2 + code_block
count_3 = List.Count(list=filterByBoolMask_3.in)
add_8 = lastItem_2 + count_3
range_3 = Range(start=add_7, end=add_8, step=code_block)
string_from_object_5 = FromObject(obj=range_3)
add_9 = string_4 + string_from_object_5
add_10 = add_9 + string_5
string_from_object_6 = FromObject(obj=add_10)
setParameterByName_3 = Element.SetParameterByName(element=filterByBoolMask_3.in, parameterName=string_3, value=string_from_object_6)
